# Dynamo custom node intParamFilter.dyf (Dynamo 2.3.1.11775)
# category: Test.ifc.filter
# 数値型プロパティに対するフィルター

element = Input(element: var[]..[])  # Elements
param = Input(param: string)  # Parameter
getParameterValueByName = Element.GetParameterValueByName(element=element, parameterName=param)
value = Input(value: int)  # Target parameter values
logic = Input(logic: string = "==")  # Logic for Param (defalt is equal)
python_script = Python(IN[0]=element, IN[1]=getParameterValueByName, IN[2]=value, IN[3]=logic)
# ---------- python_script.python (38 lines) ----------
# Python 標準ライブラリおよび DesignScript ライブラリをロード
import sys
import clr
clr.AddReference('ProtoGeometry')
from Autodesk.DesignScript.Geometry import *

import operator

# このノードへの入力は、リスト形式で IN 変数に格納されます。
elements = IN[0]
params = IN[1]
compare_value = IN[2]
oper = IN[3]

ops = {
    '==' : operator.eq,
	'<' : operator.lt,
	'<=' : operator.le,
	'>' : operator.gt,
	'>=' : operator.ge,
	'!=' : operator.ne,
}

ok = list()
ng = list()

def eval_binary_expr(op1, oper, op2):
    return ops[oper](op1, op2)
	
# この行の下にコードを配置します
for e, p in zip(elements, params):
	if eval_binary_expr(e, oper, p):
		ok.append(e)
	else:
		ng.append(e)
		
# 出力を OUT 変数に割り当てます。
OUT = [ok, ng]
# ----------------------------------------
code_block = CodeBlock { 0; 1; }
getItemAtIndex = List.GetItemAtIndex(list=python_script, index=code_block.out0)
ok = Output(getItemAtIndex)  # 適合Elements
getItemAtIndex_2 = List.GetItemAtIndex(list=python_script, index=code_block.out1)
ng = Output(getItemAtIndex_2)  # 不適合Elements
