# Dynamo custom node law21_1.dyf (Dynamo 2.3.1.11775)
# category: Test.standardlaw.body
# 基準法21条1項の判定
# packages: Test package 0.0.1

element = Input(element: var[]..[])  # Elements
code_block = CodeBlock { "FireRating"; "2h"; }
list_create = List.Create(item0=code_block.out1)
stringParamFilter = Custom[stringParamFilter](element=element, param=code_block.out0, values=list_create)  # package Test package; stringのパラメータのElementsをFilterする
ng = Output(stringParamFilter.ng)  # 不適合Elements
ok = Output(stringParamFilter.ok)  # 適合Elements
