# Dynamo custom node mainStrucElements.dyf (Dynamo 2.3.1.11775)
# category: Test.standardlaw.definition
# 主要構造部Elements
# packages: Test package 0.0.1

categories = Categories("OST_Walls")
all_elements_of_category = ElementsOfCategory(Category=categories)
code_block = CodeBlock { "LoadBearing"; }
boolean = BoolSelector(true)
boolParamFilter = Custom[boolParamFilter](element=all_elements_of_category, param=code_block, value=boolean)  # package Test package; bool型のPsetのElementsを分ける
wall = Input(wall: bool = true)  # 壁
list_create = List.Create(item0=wall)
logicalANDSwitch = Custom[logicalANDSwitch](value=boolParamFilter.ok, bools=list_create)  # package Test package; boolフィールドの値がすべてtrueの場合値を通過させます
categories_2 = Categories("OST_StructuralColumns")
all_elements_of_category_2 = ElementsOfCategory(Category=categories_2)
boolParamFilter_2 = Custom[boolParamFilter](element=all_elements_of_category_2, param=code_block, value=boolean)
column = Input(column: bool = true)  # 構造柱
list_create_2 = List.Create(item0=column)
logicalANDSwitch_2 = Custom[logicalANDSwitch](value=boolParamFilter_2.ok, bools=list_create_2)
categories_3 = Categories("OST_Floors")
all_elements_of_category_3 = ElementsOfCategory(Category=categories_3)
boolParamFilter_3 = Custom[boolParamFilter](element=all_elements_of_category_3, param=code_block, value=boolean)
slab = Input(slab: bool = true)  # 床
list_create_3 = List.Create(item0=slab)
logicalANDSwitch_3 = Custom[logicalANDSwitch](value=boolParamFilter_3.ok, bools=list_create_3)
categories_4 = Categories("OST_StructuralFraming")
all_elements_of_category_4 = ElementsOfCategory(Category=categories_4)
boolParamFilter_4 = Custom[boolParamFilter](element=all_elements_of_category_4, param=code_block, value=boolean)
beam = Input(beam: bool = true)  # 梁
list_create_4 = List.Create(item0=beam)
logicalANDSwitch_4 = Custom[logicalANDSwitch](value=boolParamFilter_4.ok, bools=list_create_4)
categories_5 = Categories("OST_Roofs")
all_elements_of_category_5 = ElementsOfCategory(Category=categories_5)
boolParamFilter_5 = Custom[boolParamFilter](element=all_elements_of_category_5, param=code_block, value=boolean)
roof = Input(roof: bool = true)  # 屋根
list_create_5 = List.Create(item0=roof)
logicalANDSwitch_5 = Custom[logicalANDSwitch](value=boolParamFilter_5.ok, bools=list_create_5)
categories_6 = Categories("OST_Stairs")
all_elements_of_category_6 = ElementsOfCategory(Category=categories_6)
boolParamFilter_6 = Custom[boolParamFilter](element=all_elements_of_category_6, param=code_block, value=boolean)
stair = Input(stair: bool = true)  # 階段
list_create_6 = List.Create(item0=stair)
logicalANDSwitch_6 = Custom[logicalANDSwitch](value=boolParamFilter_6.ok, bools=list_create_6)
join = List.Join(list0=logicalANDSwitch, list1=logicalANDSwitch_2, list2=logicalANDSwitch_3, list3=logicalANDSwitch_4, list4=logicalANDSwitch_5, list5=logicalANDSwitch_6)
element = Output(join)  # 主要構造部Element
